# Dynamo graph Algorithm.dyn "algorytm_mgr2_MWU23" (Dynamo 2.10.1.3976)
# packages: GenerativeDesign 1.7.3.0

# group: Dane
jednostkaTerenowa = SelectFaces()  # 1 picked in the model
flatten = List.Flatten(list=jednostkaTerenowa)
remember = Data.Remember(flatten)
wartoscZielony = CodeBlock { 255; }
byARGB = Color.ByARGB(g=wartoscZielony)
byGeometryColor = Modifiers.GeometryColor.ByGeometryColor(geometry=remember, color=byARGB)
czyPodziałCiaguNaOLZ = BoolSelector(true)  # graph input
obowiazujacaLiniaZabudowy = DSModelElementsByCategorySelection(index=134)  # 4 picked in the model
geometry = Element.Geometry(element=obowiazujacaLiniaZabudowy)
remember_2 = Data.Remember(geometry)
szerokoscBudynku = DoubleSlider(17, range=12..17 step 0.1)  # graph input
zakladanaPowierzchniaSegmentu = DoubleSlider(260, range=180..260 step 0.01)  # graph input
wskaznikMiejscaPodzialuOLZ = DoubleSlider(0.5, range=0..1 step 0.01)  # graph input
wskaznikDlugosciPodzialuOLZ = DoubleSlider(0.07, range=0..0.2 step 0.01)  # graph input
liczbaKondygnacji = IntegerSlider64Bit(5, range=5..8 step 1)  # graph input
wartoscioweZadrzewienia = SelectFaces()  # 2 picked in the model
remember_3 = Data.Remember(wartoscioweZadrzewienia)
terenZagospodarowany = SelectFaces()  # 1 picked in the model
remember_4 = Data.Remember(terenZagospodarowany)
join = List.Join(list0=remember_3, list1=remember_4)
flatten_2 = List.Flatten(list=join)
liniaPodzialu = DSModelElementsByCategorySelection(index=134)  # 1 picked in the model
geometry_2 = Element.Geometry(element=liniaPodzialu)
remember_5 = Data.Remember(geometry_2)
nieprzekraczalnaLiniaZabudowy = DSModelElementsByCategorySelection(index=134)  # 1 picked in the model
geometry_3 = Element.Geometry(element=nieprzekraczalnaLiniaZabudowy)
remember_6 = Data.Remember(geometry_3)
odsuniecieOdGranicy = DoubleSlider(5, range=5..15 step 0.1)  # graph input
wskaznikOdrzucenia = IntegerSlider64Bit(5, range=2..5 step 1)  # graph input
offsetOdrzucenia = IntegerSlider64Bit(1, range=0..2 step 1)  # graph input
przebiegDrogiWewnetrznej = DSModelElementsByCategorySelection(index=134)  # 1 picked in the model
geometry_4 = Element.Geometry(element=przebiegDrogiWewnetrznej)
remember_7 = Data.Remember(geometry_4)
minSzerDrogiWewn = DoubleSlider(12.2, range=8..16 step 0.1)  # graph input
istniejacyBudynek = DSModelElementsByCategorySelection(index=3)  # 1 picked in the model
geometry_5 = Element.Geometry(element=istniejacyBudynek)
remember_8 = Data.Remember(geometry_5)

code_block = CodeBlock { 1; }

# group: Wektor wysokości budynków
wysokoscBudynku = CodeBlock(LiczbaKondygnacji=liczbaKondygnacji) { LiczbaKondygnacji*3.5; }
byCoordinates = Vector.ByCoordinates(z=wysokoscBudynku)

# group: Budynki wzdłuż obowiązującej linii zabudowy
flatten_3 = List.Flatten(list=remember_2)
byJoinedCurves = PolyCurve.ByJoinedCurves(curves=flatten_3)
code_block_2 = CodeBlock(szerokosc=szerokoscBudynku) { -szerokosc/2; }
offset = Curve.Offset(curve=byJoinedCurves, distance=code_block_2)
dlugoscSegmentu = CodeBlock(pow=zakladanaPowierzchniaSegmentu, szer=szerokoscBudynku) { pow/szer; }
length = Curve.Length(curve=offset)
punktPodzialu = CodeBlock(DS=dlugoscSegmentu, DL=length, msc=wskaznikMiejscaPodzialuOLZ) { DS/DL+(msc*(1-(2*(DS/DL)))); }
code_block_3 = CodeBlock { 0.5; }
le = punktPodzialu <= code_block_3
add = punktPodzialu + wskaznikDlugosciPodzialuOLZ
sub = punktPodzialu - wskaznikDlugosciPodzialuOLZ
if_ = If(test=le, true=add, false=sub)
list_create = List.Create(item0=punktPodzialu, item1=if_, item2=code_block)
sort = List.Sort(list=list_create)
splitByParameter = Curve.SplitByParameter(curve=offset, parameters=sort)
code_block_4 = CodeBlock { 2; 0; }
dropEveryNthItem = List.DropEveryNthItem(list=splitByParameter, n=code_block_4.out0, offset=code_block_4.out1)
if_2 = If(test=czyPodziałCiaguNaOLZ, true=dropEveryNthItem, false=offset)
extrude = Curve.Extrude(curve=if_2, direction=byCoordinates)
thicken = Surface.Thicken(surface=extrude, thickness=szerokoscBudynku)
byUnion = Solid.ByUnion(solids=thicken)

# group: Obszar dozwolonej zabudowy
difference = Surface.Difference(surface=remember, others=flatten_2)
split = Geometry.Split(geometry=difference@L1, other=remember_5)
flatten_4 = List.Flatten(list=remember_6)
code_block_5 = CodeBlock { -5; }
translate = Geometry.Translate(geometry=flatten_4, zTranslation=code_block_5)
code_block_6 = CodeBlock { 10; }
byCoordinates_2 = Vector.ByCoordinates(z=code_block_6)
extrude_2 = Curve.Extrude(curve=translate, direction=byCoordinates_2)
byJoinedSurfaces = PolySurface.ByJoinedSurfaces(surfaces=extrude_2)
split_2 = Geometry.Split(geometry=split, other=byJoinedSurfaces)
area = Surface.Area(surface=split_2)
average = Math.Average(numbers=area)
ge = area >= average
filterByBoolMask = List.FilterByBoolMask(list=split_2, mask=ge)
flatten_5 = List.Flatten(list=filterByBoolMask.in)

# group: Przestrzeń na drogę wewętrzną
extrude_3 = Curve.Extrude(curve=remember_7, direction=byCoordinates)
thicken_2 = Surface.Thicken(surface=extrude_3, thickness=minSzerDrogiWewn)

# group: Zabudowa blokowa
perimeterCurves = Surface.PerimeterCurves(surface=flatten_5)
byJoinedCurves_2 = PolyCurve.ByJoinedCurves(curves=perimeterCurves)
obliczony_offset = CodeBlock(odsuniecie=odsuniecieOdGranicy, szerokosc=szerokoscBudynku) { -1*(odsuniecie+1/2*szerokosc); }
offset_2 = Curve.Offset(curve=byJoinedCurves_2, distance=obliczony_offset)
length_2 = Curve.Length(curve=offset_2)
liczba_segmentow = CodeBlock(Dlugosc=length_2, Powierzchnia=zakladanaPowierzchniaSegmentu, Szerokosc=szerokoscBudynku) { Dlugosc/(Powierzchnia/Szerokosc); }
code_block_7 = CodeBlock(step=liczba_segmentow) { 0..1..1/step; }
splitByParameter_2 = Curve.SplitByParameter(curve=offset_2, parameters=code_block_7)
dropEveryNthItem_2 = List.DropEveryNthItem(list=splitByParameter_2@L2, n=wskaznikOdrzucenia, offset=offsetOdrzucenia)
extrude_4 = Curve.Extrude(curve=dropEveryNthItem_2, direction=byCoordinates)
thicken_3 = Surface.Thicken(surface=extrude_4, thickness=szerokoscBudynku)
differenceAll = Solid.DifferenceAll(solid=thicken_3, others=thicken_2)
volume = Solid.Volume(solid=differenceAll)
average_2 = Math.Average(numbers=volume)
code_block_8 = CodeBlock(srednia=average_2) { 0.75*srednia; }
gt = volume > code_block_8
filterByBoolMask_2 = List.FilterByBoolMask(list=differenceAll, mask=gt)

# group: Selekcja budynków
distanceTo = Geometry.DistanceTo(geometry=byUnion, other=filterByBoolMask_2.in)
poziomDolnejKrawedziOkna = CodeBlock { 1.5; }
minimalnaodlegloscobiektuprzesla = CodeBlock(Hbudynku=wysokoscBudynku, Hparapetu=poziomDolnejKrawedziOkna) { Hbudynku-Hparapetu; }  # "MinimalnaOdlegloscObiektuPrzeslaniajacego;"
ge_2 = distanceTo >= minimalnaodlegloscobiektuprzesla
filterByBoolMask_3 = List.FilterByBoolMask(list=filterByBoolMask_2.in, mask=ge_2)
byUnion_2 = Solid.ByUnion(solids=filterByBoolMask_3.in)
separate = Solid.Separate(solid=byUnion_2)
flatten_6 = List.Flatten(list=separate)
join_2 = List.Join(list0=byUnion, list1=flatten_6, list2=remember_8)
color_palette = ColorPalette({R: 255, G: 255, B: 255, A: 255})
byGeometryColor_2 = Modifiers.GeometryColor.ByGeometryColor(geometry=join_2, color=color_palette)

# group: Wskaźniki
bySolid = PolySurface.BySolid(solid=join_2)
surfaces = PolySurface.Surfaces(polySurface=bySolid)
flatten_7 = List.Flatten(list=surfaces)
difference_2 = Surface.Difference(surface=remember, others=flatten_7)
difference_3 = Surface.Difference(surface=remember, others=difference_2)
powBudynkow = Surface.Area(surface=difference_3)
powBudynkowZListy = List.FirstItem(list=powBudynkow)
powBud = Watch(powBudynkowZListy)
powTerenu = Surface.Area(surface=remember)
powTerenuZTabeli = List.FirstItem(list=powTerenu)
powTer = Watch(powTerenuZTabeli)
PBC = Surface.Area(surface=difference_2)
PBCzListy = List.FirstItem(list=PBC)
PBC_2 = Watch(PBCzListy)
code_block_9 = CodeBlock(PB=powBud, LK=liczbaKondygnacji, PT=powTer, PBC=PBC_2) { PB*LK/PT; PBC/PT; }
wskaznikPBC = Watch(code_block_9.out1)  # graph output
intensywnoscZabudowy = Watch(code_block_9.out0)  # graph output
liczbaBudynkow = List.Count(list=join_2)  # graph output

perimeterCurves_2 = Surface.PerimeterCurves(surface=remember)
